# Grasshopper definition rammeprogram.gh (Grasshopper 0.9.76)
# plug-ins: Python Interpreter

panel = Panel("""0,1,0
1,2,0
2,3,0
3,4,0
4,5,0
5,6,0
6,7,0
7,8,0
8,9,0
9,10,0
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""")
panel_2 = Panel("""0,20
10,20
20,20
30,20
40,20
50,20
60,20
70,20
80,20
90,20
100,20
110,20
120,20
0,0
10,5.23
20,9.51
30,12.84
40,15.21
50,16.64
60,17.12
70,16.64
80,15.21
90,12.84
100,9.51
110,5.23
120,0""")
pt = Point(panel)
pt_2 = Point(panel_2)
pdecon = Deconstruct(Point=panel)  # -> XComponent, YComponent, ZComponent
panel_3 = Panel("""     14 11
14 2 0
                      14 6 0
                      26 1 0
                      26 2 0
                      1 2 0
                      7 1 0
                      13 2 0""")
int = Integer(pdecon.XComponent)
int_2 = Integer(pdecon.YComponent)
lng = ListLength(List=pt_2)
xy = XYPlane(Origin=pt_2)
bbox = BoundingBox(Content=pt_2, Plane=PlaneXY(0, 0, 0), UnionBox=True)  # -> Box, Box_2
item = ListItem(List=pt_2, Index=int, Wrap=True)
item_2 = ListItem(List=pt_2, Index=int_2, Wrap=True)
python = PythonScript(topolist=pt, nodes=pt_2)  # -> out, elements; inputs topolist: list, nodes: list
# ---------- python: Python ----------
import rhinoscriptsyntax as rs
import scriptcontext
import Rhino
scriptcontext.doc = ghdoc
startpoint=[]
endpoint=[]
eleProp=[]
elements=[]

for topo in topolist:
    indices=str(rs.PointCoordinates(topo)).split(",")
    stpt=nodes[int(indices[0])]
    enpt=nodes[int(indices[1])]
    startpoint.append(stpt)
    endpoint.append(enpt)
    elements.append(rs.AddLine(stpt,enpt))
    #eleProp.append(nodes[indices[2]])
# ---------- end python ----------
series = Series(Start=0, Step=1, Count=lng)
crv = Curve(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)
crv_2 = Curve(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)
crv_3 = Curve(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)
area = Area(Geometry=bbox.Box)  # -> Area, Centroid
series_2 = Series(Start=0, Step=1, Count=10)
panel_4 = Panel("""14,1
14,2
14,3
26,1
26,2
1,2
7,1
13,2""")
ln = Line(StartPoint=item, EndPoint=item_2)
merge = Merge(Data1=crv, Data2=crv_2, Data3=crv_3)
int_3 = Integer(series)
division = Division(A=area.Area, B=1000)
scale = Scale(Geometry=merge, Center=Point(0, 0, 0), Factor=division)  # -> Geometry, Transform
tag = TextTag3D(Location=pt_2, Text=int_3, Size=division, Justification=7)
